vi "Day 1.gvi"   [LabVIEW NXG 3.1.0]
panel controls:
  "Day 1 Clean Input File": path = path "C:\\Repositories\\LabVIEW\\AdventOfCode-LabVIEW\\Advent of Code - 2018\\Day 1\\Day 1 Input.txt"
  "Use Clean Input?": bool
  "Day 1 Raw Input File": path = path "C:\\Repositories\\LabVIEW\\AdventOfCode-LabVIEW\\Advent of Code - 2018\\Day 1\\Day 1 Raw Input.txt"
panel indicators:
  "size(s)": i32
  "frequency shift array": i32[]
  "sum": i32
  "unsigned byte array": u8[]
  "Unique Frequencies": i32[]
  "First Repeat Frequency": i32
  "Time Elapsed (s)": f64
  "Unique Frequency Size": i32
diagram:
  call "Get Freq Shifts.gvi"(Day 1 Clean Input File=$"Day 1 Clean Input File", Day 1 Raw Input File=$"Day 1 Raw Input File", Use Clean Input?=$"Use Clean Input?") -> (Frequency Shifts=w1, size(s)=w2, sum=w3, unsigned byte array=w4)
  $"frequency shift array" <- w1
  call "Get First Repeat Freq.gvi"(Frequency Shifts=w1) -> (First Repeat Frequency=w5, Unique Frequencies=w6, # Unique Frequencies=w7, Time Elapsed (s)=w8)
  $"First Repeat Frequency" <- w5
  $"Unique Frequencies" <- w6
  $"Unique Frequency Size" <- w7
  $"Time Elapsed (s)" <- w8
  $"size(s)" <- w2
  $sum <- w3
  $"unsigned byte array" <- w4
