vi "Get First Repeat Freq.gvi"   [LabVIEW NXG 3.1.0]
inputs:
  "Frequency Shifts": i32[]
outputs:
  "Time Elapsed (s)": f64
  "Unique Frequencies": i32[]
  "# Unique Frequencies": i32
  "First Repeat Frequency": i32
diagram:
  sequence {
    frame 0 {
      Get Current Time() -> (current time=w1)
    }
    frame 1 {
      w2 = i32[] []  # Starting Unique Freqs
      w3 = 0  # Starting Freq
      s1 = w2  # shift register
      s2 = w3  # shift register
      while {
        # s1: Unique Freqs
        # s2: Current Freq
        # $"Frequency Shifts": Freq Shifts
        s3 = s1  # shift register
        s4 = s2  # shift register
        for {
          w4 = each element of $"Frequency Shifts"
          # w5: Adjusted Freq
          Add(s4, w4) -> w5
          Search 1D Array(1D array=s3, element=w5) -> (index of element=w6)
          Is Equal(x=w6, y=-1) -> w7
          case (w7) {
            frame False, Default {
              # Found a repeat!
              w8 = s3
              w9 = w5
            }
            frame True {
              # If new, add
              Insert Into Array(inArray=s3, new=w5) -> w8
              w9 = w5
            }
          }
          next s3 = w8
          next s4 = w9
          continue if w7
        }
        next s1 = s3
        next s2 = s4
        continue if w7
      }
    }
    frame 2 {
      Get Current Time() -> (current time=w10)
    }
  }
  Time Stamp Subtract(x=w10, y=w1) -> w11
  $"Time Elapsed (s)" <- w11
  $"Unique Frequencies" <- s1
  Array Size(array=s1) -> (size(s)=w12)
  $"# Unique Frequencies" <- w12
  $"First Repeat Frequency" <- s2
