vi "Get Freq Shifts.gvi"   [LabVIEW NXG 3.1.0]
inputs:
  "Day 1 Clean Input File": path = path "C:\\Repositories\\LabVIEW\\AdventOfCode-LabVIEW\\Advent of Code - 2018\\Day 1\\Day 1 Input.txt"
  "Day 1 Raw Input File": path = path "C:\\Repositories\\LabVIEW\\AdventOfCode-LabVIEW\\Advent of Code - 2018\\Day 1\\Day 1 Raw Input.txt"
  "Use Clean Input?": bool
outputs:
  "unsigned byte array": u8[]
  "Frequency Shifts": i32[]
  "size(s)": i32
  "sum": i32
diagram:
  Select(s=$"Use Clean Input?", t=$"Day 1 Clean Input File", f=$"Day 1 Raw Input File") -> w1
  Read From Text File(file (use dialog)=w1) -> (error out=w2, refnum out=w3, text=w4)
  # Needed to know what the Delimiter was for the source file.
  String To Byte Array(string=w4) -> (unsigned byte array=w5)
  $"unsigned byte array" <- w5
  Close File(error in=w2, refnum=w3)
  w6 = "\n"  # Line Feed Constant
  Select(s=$"Use Clean Input?", t=",", f=w6) -> w7
  Spreadsheet String To Array(array type=i32[] [], delimiter=w7, format string="%f", spreadsheet string=w4) -> (array=w8)
  $"Frequency Shifts" <- w8
  Array Size(array=w8) -> (size(s)=w9)
  $"size(s)" <- w9
  Add Array Elements(numeric array=w8) -> (sum=w10)
  $sum <- w10
